# Grasshopper definition Graph.TemperatureRange.ghx (Grasshopper 1.0.7)

path = FilePath("/Users/yukio/Documents/GitHub/GH-FuncBase/[Graph]/Temperature Range/Liverpool DBT Monthly.csv")
file = ReadFile(File=path, PerLineParse=True)
panel = Panel(file)
split = TextSplit(Text=file, Separators=",")  # -> simplify(Result)
lng = ListLength(List=split)  # -> flatten(Length)
bnd = Bounds(Numbers=lng)
dedomain = DeconstructDomain(Domain=bnd)  # -> Start, End
culln = CullNth(List=split, CullFrequency=dedomain.End)
flip = FlipMatrix(Data=culln)  # -> simplify(Data)
panel_2 = Panel(flip)
bang = ExplodeTree(Data=panel_2)  # -> Branch0, Branch1, Branch2, Branch3, Branch4, Branch5, Branch6, Branch7

lng_2 = ListLength(List=bang.Branch1)
dom = ConstructDomain(DomainStart=Slider(4, range=0..10), DomainEnd=expr("x-1", lng_2))
subset = SubList(List=bang.Branch1, Domain=dom, Wrap=True)  # -> List, Index

lng_3 = ListLength(List=bang.Branch2)
dom_2 = ConstructDomain(DomainStart=Slider(4, range=0..10), DomainEnd=expr("x-1", lng_3))
subset_2 = SubList(List=bang.Branch2, Domain=dom_2, Wrap=True)  # -> List, Index

lng_4 = ListLength(List=bang.Branch3)
dom_3 = ConstructDomain(DomainStart=Slider(4, range=0..10), DomainEnd=expr("x-1", lng_4))
subset_3 = SubList(List=bang.Branch3, Domain=dom_3, Wrap=True)  # -> List, Index

lng_5 = ListLength(List=bang.Branch4)
dom_4 = ConstructDomain(DomainStart=Slider(4, range=0..10), DomainEnd=expr("x-1", lng_5))
subset_4 = SubList(List=bang.Branch4, Domain=dom_4, Wrap=True)  # -> List, Index

lng_6 = ListLength(List=bang.Branch5)
dom_5 = ConstructDomain(DomainStart=Slider(4, range=0..10), DomainEnd=expr("x-1", lng_6))
subset_5 = SubList(List=bang.Branch5, Domain=dom_5, Wrap=True)  # -> List, Index

xz = XZPlane(Origin=Point(0, 0, 0))
number_slider = Slider(4, range=0..10)
recgrid = Rectangular(Plane=xz, SizeX=number_slider, SizeY=2, ExtentX="12", ExtentY="1")  # -> Cells, Points
flip_2 = FlipMatrix(Data=recgrid.Points)
lng_7 = ListLength(List=flip_2)
culln_2 = CullNth(List=flip_2, CullFrequency=lng_7)
flip_3 = FlipMatrix(Data=culln_2)
item = ListItem(List=flip_3, Index=0, Wrap=True)
division = Division(A=number_slider, B="2")
X = UnitX(Factor=division)
pt = Point(item)
move = Move(Geometry=pt, Motion=X)  # -> flatten(Geometry), Transform
pdecon = Deconstruct(Point=move.Geometry)  # -> XComponent, YComponent, ZComponent
division_2 = Division(A=Slider(17, range=0..100), B="100")
pt_2 = ConstructPoint(XCoordinate=pdecon.XComponent, YCoordinate=0, ZCoordinate=subset.List)
multiplication = Multiplication(A=division, B=division_2)
pt_3 = Point(pt_2)
box = CenterBox(Base=pt_3, X=multiplication, Y=1, Z=Slider(0.5, range=0..5))

subtraction = Subtraction(A=subset_3.List, B=subset_2.List)
division_3 = Division(A=subtraction, B="2")
number_slider_2 = Slider(0.3, range=0..1)
pt_4 = ConstructPoint(XCoordinate=pdecon.XComponent, YCoordinate=0, ZCoordinate=subset_4.List)
pt_5 = ConstructPoint(XCoordinate=pdecon.XComponent, YCoordinate=0, ZCoordinate=subset_5.List)
sph = Sphere(Base=pt_4, Radius=number_slider_2)
sph_2 = Sphere(Base=pt_5, Radius=number_slider_2)
box_2 = CenterBox(Base=pt_3, X=multiplication, Y=1, Z=division_3)
